# Grasshopper definition basic_line.gh (Grasshopper 1.0.7)
# plug-ins: Kangaroo2 Components

# ---- group: RH_IN:radius
radius = Slider(621, range=5..1000)

# ----
circle = Circle(Plane=PlaneXY(-4.809126849, -4.768098222, 0), Radius=radius)
mp = MultiPipe(Curves=<missing>, NodeSize=<missing>, EndOffset=1, StrutSize=1, Segment=0, KinkAngle=0.6, CubeFit=0)

# ---- group: RH_OUT:curve
curve = Curve(circle)
