# Grasshopper definition shape.gh (Grasshopper 1.0.7)

seed = Slider(1000, range=0..1000)
sphere = Sphere(Base=PlaneXY(0, 0, 0), Radius=Slider(17, range=0..30))
popgeo = PopulateGeometry(Geometry=sphere, Count=Slider(3, range=0..10), Seed=seed)
list_item = ListItem(List=popgeo, Index=0, Wrap=True)
list_item_2 = ListItem(List=popgeo, Index=1, Wrap=True)
list_item_3 = ListItem(List=popgeo, Index=2, Wrap=True)
arc_3pt = Arc3Pt(PointA=list_item, PointB=list_item_2, PointC=list_item_3)  # -> Arc, Plane, Radius

# ---- group: RH_IN:count
count = Slider(8, range=2..20)

# ----
range = Range(Domain=Slider(360, range=0..360), Steps=count)
rotate = Rotate(Geometry=arc_3pt.Arc, Angle=degrees(range), Plane=PlaneXY(0, 0, 0))  # -> Geometry, Transform
cull_index = CullIndex(List=rotate.Geometry, Indices=Slider(-1, range=-1..100), Wrap=True)
construct_domain = ConstructDomain(DomainStart=Slider(10, range=0..10), DomainEnd=Slider(20, range=0..20))
list_length = ListLength(List=cull_index)
random = Random(Range=construct_domain, Number=list_length, Seed=Slider(1.2, range=0..10))
extend_curve = ExtendCurve(Curve=cull_index, Type=Slider(0, range=0..2), Start=Slider(0, range=0..2), End=random)
merge = Merge(Data1=Slider(0, range=0..1), Data2=Slider(0.74, range=0..1), Data3=Slider(0.9, range=0..1), Data4=Slider(1, range=0..1))
merge_2 = Merge(Data1=Slider(1, range=0..1), Data2=Slider(1, range=0..1), Data3=Slider(0.67, range=0..1), Data4=Slider(1, range=0..1))
pipe_variable = PipeVariable(Curve=reparameterize(extend_curve), Parameters=merge, Radii=merge_2, Caps=2)  # -> flatten(Pipe)
solid_union = SolidUnion(Breps=pipe_variable)

# ---- group: RH_OUT:mesh
mesh = Mesh(solid_union)
